vi "webvipolyfill.gviweb"   [LabVIEW NXG 2.1.0]
inputs:
  "action": string, required
  "input": string, required
  "error in": error
outputs:
  "output": string
  "error out": error
uses:
  NI::HTTP::POST Buffer.gvi
diagram:
  Concatenate Strings("webvipolyfill:", $action) -> w1
  call "POST Buffer.gvi"(timeout=-1, client handle=0, url=w1, buffer=$input, error in=$"error in", output file=path constant) -> (body=w2, error out=w3)
  $output <- w2
  $"error out" <- w3
